# Grasshopper definition D2F_Information_Model.ghx (Grasshopper 1.0.7)

bang = Button()
panel = Panel("Unload libraries")
unload = PythonScript(bang=bang)
# ---------- unload: Python ----------
from compas_rhino.utilities.misc import get_tolerance
from compas_rhino.utilities.misc import unload_modules

unload_modules("am_information_model")
# ---------- end unload ----------

show = BooleanToggle(True)
pt = Point([Point(-0.6988636097, -0.467318018, 0), Point(-1.104355128, -0.3483738393, 0), Point(-0.8962028153, -0.1172436739, 0), Point(-0.5718096007, -0.3118796027, 0), Point(-0.3920416942, -0.1618477409, 0), Point(-0.4663818059, 0.1476774514, 0), Point(-0.7394127616, 0.05035948698, 0), Point(-1.107058405, 0.1517323665, 0), Point(-0.9321600238, 0.214722343, 0), Point(-0.8624436836, 0.4044887463, 0)])

# ----
# Ex1
# Points (nodes) to Path
# Visualise the defined element
panel_2 = Panel("Predefine an points")
show_2 = BooleanToggle(True)
path_def = GhPythonScript(bang=bang, pts=pt)  # -> out, path; inputs pts: list of Point3d
# ---------- path_def: Python ----------
import os
import sys
import json

from compas.geometry import Frame
from compas.geometry import Line
from compas.geometry import Vector

from am_information_model.model import Edge, Path, Node

# nodes
nodes = []
frames = [Frame([pt.X, pt.Y, pt.Z], [0, -1, 0], [-1, 0, 0]) for pt in pts]

for i,frame in enumerate(frames):
    nodes.append(Node(frame=frame))
path = Path.from_nodes(nodes)

print(path.data)
for key, data in path.nodes(data=True):
    print(key, path.neighbors(key))
# ---------- end path_def ----------
draw = PythonScript(path=path_def.path, show_nodes=show_2, show_edges=show)  # -> T, F, E
# ---------- draw: Python ----------
from compas.geometry import Transformation
from compas.geometry import Frame, Line
from compas.datastructures import mesh_transformed
from compas_ghpython.artists import MeshArtist
from compas_ghpython import draw_frame, draw_lines, draw_points
from ghpythonlib.components import TextTag
import Rhino.Geometry as rg

keys = []
nodes = []
for key, node in path.nodes(data=True):
    keys.append(key)
    nodes.append(node["node"])

F = []
T = []

if show_nodes:
    F.extend([draw_frame(node.frame) for node in nodes])
    T.extend([key for key in keys])

if show_edges:
    points = [node["node"].frame.point.data for key, node in path.nodes(data=True)]
    lines = [{"start": points[keys.index(e[0])], "end": points[keys.index(e[1])]} for e in path.edges()]
    E = draw_lines(lines)
    cmidpts = [Line.from_data(line).midpoint for line in lines]
    F.extend(draw_points([{"pos":(p.x, p.y, p.z)} for p in cmidpts]))
    T.extend(["length="+str(edge["edge"].length) for e, edge in path.edges(data=True)])
# ---------- end draw ----------

crv = Curve(<curve referenced from the Rhino model>)

# ----
# Ex2
# Curve
# Predefine an element and its dimensions
# Visualise the defined element
number_slider = Slider(0.2, range=0..1)
show_3 = BooleanToggle(False)
layer_def = GhPythonScript(crv=crv, div_length=number_slider)  # -> out, layer; inputs crv: Curve
# ---------- layer_def: Python ----------
import rhinoscriptsyntax as rs
import os
import sys
import json

from compas.geometry import Frame
from compas.geometry import Line
from compas.geometry import Vector

from am_information_model.model import Node
from am_information_model.model import Layer

def _radius_between_frames(from_frame, via_frame, to_frame, max_radius):
        in_line = Line(from_frame.point, via_frame.point)
        out_line = Line(via_frame.point, to_frame.point)
        r = min(max_radius, in_line.length/2, out_line.length/2)
        return r

# nodes
print crv
pts = rs.DivideCurveLength(crv, div_length)
max_r = div_length/2
nodes = []
frames = [Frame([pt.X, pt.Y, pt.Z], [0, -1, 0], [-1, 0, 0]) for pt in pts]

for i,frame in enumerate(frames):
    r = _radius_between_frames(frames[max(0,i-1)], frame, frames[min(i+1, len(frames)-1)], max_r)
    nodes.append(Node(frame, radius=r))
layer = Layer.from_nodes(nodes)
# ---------- end layer_def ----------
draw_2 = PythonScript(layer=layer_def.layer, show=show_3)  # -> M, F, S
# ---------- draw_2: Python ----------
from compas.geometry import Transformation
from compas.geometry import Frame
from compas.datastructures import mesh_transformed
from compas_ghpython.artists import MeshArtist
from compas_ghpython import draw_frame

if show:
    F = [draw_frame(node.frame) for key, node in layer.nodes()]
# ---------- end draw_2 ----------

tag = TextTag(Location=draw.F, Text=draw.T)

# ----
# AM Model
number_slider_2 = Slider(0.006, range=0..0.01)
cp = Plane(PlaneXY(0, 0, 0))
generate_assembly = GhPythonScript(centerplane=cp, layer=layer_def.layer, layer_height=number_slider_2)  # -> am_model, planes
# ---------- generate_assembly: Python ----------
import Rhino.Geometry as rg
import math
from scriptcontext import sticky as st


from compas.geometry import Frame
from compas.geometry import Transformation
from compas.geometry import Rotation
from compas.geometry import Translation
from compas.geometry import Point

from compas_ghpython import draw_frame

from am_information_model.model import AMModel
from am_information_model.model import Layer

import Rhino.Geometry as rg


# initialize an empty assembly class
am_model = AMModel()

cp = centerplane
cf = Frame(cp.Origin, cp.XAxis, cp.YAxis)

for i in range(25): # loop through the number of layers i
    T = Translation.from_vector([0,0,layer_height*i])
    cft = cf.transformed(T) #transforms the origin plane

    T1 = Transformation.from_frame_to_frame(cf, cft)
    # create new instances of the element
    new_layer = layer.transformed(T) #returns a deep copy of the initial element at the new location of the frame
    print(new_layer.node(0).frame)
    am_model.add_layer(new_layer)
# ---------- end generate_assembly ----------
pln = Plane(generate_assembly.planes)

# ----
# Paths to Element
# Visualise the defined element
panel_3 = Panel("Predefine a path")
show_4 = BooleanToggle(False)
element_def = GhPythonScript(path=path_def.path, layer_height=Slider(0.01, range=0..0.01), layers=Slider(15, range=0..100))  # -> out, element; inputs layers: Int32
# ---------- element_def: Python ----------
import os
import sys
import json

from compas.geometry import Frame
from compas.geometry import Line
from compas.geometry import Vector
from compas.geometry import Translation

from am_information_model.model import Element, Path

element = Element()

for l in range(layers):
    T = Translation.from_vector([0,0,layer_height*l])
    new_path = path.transformed(T)
    key, node_4 = new_path.get_node("node_1", True, "node")
    Tn4 = Translation.from_vector([-(layer_height/2)*l,0,0])
    node_4.transform(Tn4)
    element.add_path(new_path)

print(element.get_path("path_14", data=True))
print(element.data)
#for key, data in path.nodes(data=True):
#    print(key, path.neighbors(key))
# ---------- end element_def ----------
draw_3 = PythonScript(element=element_def.element, show=show_4)  # -> T, F, E
# ---------- draw_3: Python ----------
from compas.geometry import Transformation
from compas.geometry import Frame
from compas.datastructures import mesh_transformed
from compas_ghpython.artists import MeshArtist
from compas_ghpython import draw_frame, draw_lines
from ghpythonlib.components import TextTag
import Rhino.Geometry as rg

if show:
    F = []
    T = []
    E = []
    for key, path in element.paths(data=True):
        pF = [draw_frame(node["node"].frame) for key, node in path.nodes(data=True)]
        pT = [key for key, node in path.nodes(data=True)]
        points = [[f.Origin.X,f.Origin.Y,f.Origin.Z] for f in pF]
        lines = [{"start": points[pT.index(e[0])], "end": points[pT.index(e[1])]} for e in path.edges()]
        pE = draw_lines(lines)
        F.extend(pF)
        T.extend(pT)
        E.extend(pE)
# ---------- end draw_3 ----------

tag_2 = TextTag(Location=draw_3.F, Text=draw_3.T)

list = ValueList({"20", "50", "100", "500", "1000", "5000"}, selected="50")
back = Button()
reset = Button()
start = Button()
stop = Button()
step = Button()
full = Button()

# ----
# Draw
counter = CountThroughList(
    am_model=generate_assembly.am_model,
    start=start,
    stop=stop,
    step=step,
    step_back=back,
    reset=reset,
    full=full,
    interval=list)  # -> item, counter; inputs start: Boolean, stop: Boolean, step_back: Boolean
# ---------- counter: Python ----------
from scriptcontext import sticky as st
from compas_ghpython import update_component


L = list(am_model.layers())
# store data in component
guid = str(ghenv.Component.InstanceGuid)
counter_key = "counter_" + guid
running_key = "running_" + guid

if counter_key not in st:
    st[counter_key] = 0

if running_key not in st:
    st[running_key] = False
    

if st[running_key]:
    if st[counter_key] < len(L) - 1:
        st[counter_key] += 1
        update_component(ghenv, interval)
    else:
        st[counter_key] = 0
        st[running_key] = False
    
    
if start:
    st[running_key] = True

if stop:
    st[running_key] = False

if step:
    if st[counter_key] < len(L) - 1:
        st[counter_key] += 1

if step_back:
    if st[counter_key] < len(L) - 1:
        st[counter_key] -= 1

if reset:
    st[counter_key] = 0

if full:
    st[counter_key] = len(L)-1

if len(L):
    item = L[st[counter_key]]



#st["visualisation_counter"] = st[counter_key]
counter = st[counter_key]
# ---------- end counter ----------
show_5 = BooleanToggle(False)
show_6 = BooleanToggle(False)
idx = Panel(counter.counter)
draw_4 = PythonScript(am_model=generate_assembly.am_model, show_all=show_5, show_counter=show_6, counter=idx)  # -> G, tool_planes_WCS, current_tool_plane, current_tool_planes; inputs counter: Int32
# ---------- draw_4: Python ----------
import os
import sys

import math

from compas_ghpython.artists import MeshArtist
from compas_ghpython import draw_frame


G = []

key_index = am_model.network.key_index()
keys = [key_index[key] for key in am_model.network.nodes()]
layers = [am_model.layer(key) for key in keys]
#print elements
#print([(e.gripping_frame) for e in elements])

start_planes_WCS = [draw_frame(l.node(0).frame) for l in layers]

current_tool_plane = start_planes_WCS[counter]
current_tool_planes = [draw_frame(node.frame) for key, node in am_model.layer(counter).nodes()]

if show_all and not show_counter:
    for layer in layers:
        for key, node in layer.nodes():
            plane = draw_frame(node.frame) 
            G.append(plane)

if show_counter:
    for layer in layers[0:counter+1]:
        for key, node in layer.nodes():
            plane = draw_frame(node.frame) 
            G.append(plane)

    tool_planes_WCS = [draw_frame(l.node(0).tool_frame) for l in layers[0:counter+1]]
# ---------- end draw_4 ----------
pln_2 = Plane(draw_4.tool_planes_WCS)
geo = Geometry(draw_4.G)
pln_3 = Plane(draw_4.current_tool_plane)
preview = CustomPreview(Geometry=geo, Shader=ColourSwatch(SwatchColor=RGBA(255, 227, 227, 233)))
preview_2 = CustomPreview(Geometry=[pln_2, pln_3], Shader=ColourSwatch(SwatchColor=RGBA(209, 27, 27, 178)))

# ----
# AM Model
number_slider_3 = Slider(0.006, range=0..0.01)
cp_2 = Plane(PlaneXY(0, 0, 0))
generate_assembly_2 = GhPythonScript(centerplane=cp_2, layer=path_def.path, layer_height=number_slider_3)  # -> am_model, planes; same code as generate_assembly
pln_4 = Plane(generate_assembly_2.planes)

pln_5 = Plane(draw_4.current_tool_planes)

list_2 = ValueList({"20", "50", "100", "500", "1000", "5000"}, selected="50")
back_2 = Button()
reset_2 = Button()
start_2 = Button()
stop_2 = Button()
step_2 = Button()
full_2 = Button()

# ----
# Draw
counter_2 = CountThroughList(
    am_model=generate_assembly_2.am_model,
    start=start_2,
    stop=stop_2,
    step=step_2,
    step_back=back_2,
    reset=reset_2,
    full=full_2,
    interval=list_2)  # -> item, counter; inputs start: Boolean, stop: Boolean, step_back: Boolean; same code as counter
show_7 = BooleanToggle(False)
show_8 = BooleanToggle(False)
idx_2 = Panel(counter_2.counter)
draw_5 = PythonScript(am_model=generate_assembly_2.am_model, show_all=show_7, show_counter=show_8, counter=idx_2)  # -> G, tool_planes_WCS, current_tool_plane, current_tool_planes; inputs counter: Int32; same code as draw_4
pln_6 = Plane(draw_5.tool_planes_WCS)
geo_2 = Geometry(draw_5.G)
pln_7 = Plane(draw_5.current_tool_plane)
preview_3 = CustomPreview(Geometry=geo_2, Shader=ColourSwatch(SwatchColor=RGBA(255, 227, 227, 233)))
preview_4 = CustomPreview(Geometry=[pln_6, pln_7], Shader=ColourSwatch(SwatchColor=RGBA(209, 27, 27, 178)))

pln_8 = Plane(draw_5.current_tool_planes)
